# Grasshopper definition installer.gh (Grasshopper 1.0.7)

# ----
# 3
toggle = BooleanToggle(False)

# ----
# 1
toggle_2 = BooleanToggle(False)

lbinstall = LBInstaller(install=toggle)  # -> Vviiiiiz; plug-in component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
lbsetup = LBSetupFolders(setup_folders=toggle_2)  # -> next_steps; plug-in component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

# ----
# 2
# Follow these instructions
panel = Panel(lbsetup)

panel_2 = Panel(lbinstall)
