# Grasshopper definition export_documentation.gh (Grasshopper 1.0.7)

panel = Panel("Pollination")
panel_2 = Panel("HB-Radiance")
panel_3 = Panel("Dragonfly")
panel_4 = Panel("Honeybee")
panel_5 = Panel("Fairyfly")
panel_6 = Panel("Ladybug")
panel_7 = Panel("HB-Energy")

# ----
# Export Primer
# Note that there should be no LBT components
# on the canvas when this is set to True
panel_8 = Panel("C:\ladybug\export_test")
exportprimer = ExportPrimer(plugin_name="Ironbug", folder=panel_8, export=Toggle(False))  # -> report; plug-in component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

panel_9 = Panel(exportprimer)
