# Grasshopper definition increment_components.gh (Grasshopper 1.0.7)

# ----
# Export Components
panel = Panel("C:\ladybug\export_test")
exportuo = LBExportUserObject(components="*", folder=panel, change_type="ignore", export=Toggle(False))  # -> report; plug-in component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

panel_2 = Panel("Pollination")
panel_3 = Panel("HB-Radiance")
panel_4 = Panel("Fairyfly")
panel_5 = Panel("Dragonfly")
panel_6 = Panel("Honeybee")
panel_7 = Panel("HB-Energy")

# ----
# Export Primer
# Note that there should be no LBT components
# on the canvas when this is set to True
panel_8 = Panel("C:\ladybug\export_test")
exportprimer = ExportPrimer(plugin_name="Ladybug", folder=panel_8, export=Toggle(False))  # -> report; plug-in component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

# ----
# Insert Components
toggle = BooleanToggle(False)
insertcomponents = InsertComponents(plugin_name="Ladybug", version="1.10.0", copyright_year="2026", insert=toggle)  # -> report; plug-in component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

panel_9 = Panel(exportuo)
